# Grasshopper definition scripteditor_test2.gh (Grasshopper 1.0.8)
# plug-ins: GrasshopperSever

c_script = CSharpScript()  # -> out, a; inputs y99: tree of String, z: Complex
# ---------- c_script: C# ----------
// Grasshopper Script Instance
#region Usings
using System;
using System.Linq;
using System.Collections;
using System.Collections.Generic;
using System.Drawing;

using Rhino;
using Rhino.Geometry;

using Grasshopper;
using Grasshopper.Kernel;
using Grasshopper.Kernel.Data;
using Grasshopper.Kernel.Types;
#endregion

public class Script_Instance : GH_ScriptInstance
{
    #region Notes
    /* 
      Members:
        RhinoDoc RhinoDocument
        GH_Document GrasshopperDocument
        IGH_Component Component
        int Iteration

      Methods (Virtual & overridable):
        Print(string text)
        Print(string format, params object[] args)
        Reflect(object obj)
        Reflect(object obj, string method_name)
    */
    #endregion

    private void RunScript(
		object x,
		DataTree<string> y99,
		System.Numerics.Complex z,
		ref object a)
    {
        // Write your logic here
        a = null;
    }
}
# ---------- end c_script ----------
panel = Panel("""[{
  "typeHintName": "Point3dList",
  "scriptParamAccess": 2,
  "variableName": "x",
  "optional": true
},{
  "typeHintName": "No Type Hint",
  "variableName": "y",
  "optional": true
},{
  "typeHintName": "double",
  "variableName": "z",
  "optional": true
},{
  "typeHintName": "DateTime",
  "scriptParamAccess": 1,
  "variableName": "u",
  "optional": true
}]""")
# 通过字符串修改输入端、输出端
script = ScriptEditor(ScriptComponent=c_script.out)  # -> Result, ComponentType, IsSDKMode, SourceCode, InputParams, OutputParams
# 通过代码修改输入端、输出端
c_script_2 = CSharpScript()  # -> out, a, b, c; inputs x: tree of Point3dList, z: Double, u: list of DateTime
# ---------- c_script_2: C# ----------
// GH_COMPONENT_IO_START
// INPUT_PARAMS: [{    "typeHintName": "Point3dList",    "scriptParamAccess": 2,    "variableName": "x",    "optional": true  },{    "typeHintName": "No Type Hint",    "variableName": "y",    "optional": true  },{    "typeHintName": "double",    "variableName": "z",    "optional": true  },{    "typeHintName": "DateTime",    "scriptParamAccess": 1,    "variableName": "u",    "optional": true  }]
// OUTPUT_PARAMS: 
// GH_COMPONENT_IO_END
# ---------- end c_script_2 ----------
panel_2 = Panel(script.InputParams)
py3 = Python3Script()  # -> out; inputs y99: tree of String, z: Complex
# ---------- py3: Python ----------
# GH_COMPONENT_IO_START
# INPUT_PARAMS: [{    "typeHintName": "No Type Hint",    "showTypeHints": true,    "allowTreeAccess": true,    "toolTip": "",    "scriptParamAccess": 0,    "variableName": "x",    "optional": true,    "hidden": false,    "description": "No conversion",    "castTargetType": ""  },{    "typeHintName": "string",    "showTypeHints": true,    "allowTreeAccess": true,    "toolTip": "",    "scriptParamAccess": 2,    "variableName": "y99",    "optional": true,    "hidden": false,    "description": "Converts to collection of text fragments",    "castTargetType": ""  },{    "typeHintName": "Complex",    "showTypeHints": true,    "allowTreeAccess": true,    "toolTip": "",    "scriptParamAccess": 0,    "variableName": "z",    "optional": true,    "hidden": false,    "description": "Converts to collection of complex numbers",    "castTargetType": ""  }]
# OUTPUT_PARAMS: 
# GH_COMPONENT_IO_END
# ---------- end py3 ----------
c_script_3 = CSharpScript()  # -> out; inputs y99: tree of String, z: Complex
# ---------- c_script_3: C# ----------
// GH_COMPONENT_IO_START
// INPUT_PARAMS: [{    "typeHintName": "No Type Hint",    "showTypeHints": true,    "allowTreeAccess": true,    "toolTip": "",    "scriptParamAccess": 0,    "variableName": "x",    "optional": true,    "hidden": false,    "description": "No conversion",    "castTargetType": ""  },{    "typeHintName": "string",    "showTypeHints": true,    "allowTreeAccess": true,    "toolTip": "",    "scriptParamAccess": 2,    "variableName": "y99",    "optional": true,    "hidden": false,    "description": "Converts to collection of text fragments",    "castTargetType": ""  },{    "typeHintName": "Complex",    "showTypeHints": true,    "allowTreeAccess": true,    "toolTip": "",    "scriptParamAccess": 0,    "variableName": "z",    "optional": true,    "hidden": false,    "description": "Converts to collection of complex numbers",    "castTargetType": ""  }]
// OUTPUT_PARAMS: 
// GH_COMPONENT_IO_END
# ---------- end c_script_3 ----------
script_2 = ScriptEditor(ScriptComponent=c_script_2.out, IntputParams=panel)  # -> Result, ComponentType, IsSDKMode, SourceCode, InputParams, OutputParams
script_3 = ScriptEditor(ScriptComponent=py3, IntputParams=panel_2)  # -> Result, ComponentType, IsSDKMode, SourceCode, InputParams, OutputParams
script_4 = ScriptEditor(ScriptComponent=c_script_3, IntputParams=panel_2)  # -> Result, ComponentType, IsSDKMode, SourceCode, InputParams, OutputParams
panel_3 = Panel(script_4.SourceCode)
# 通过代码修改输入端、输出端
c_script_4 = CSharpScript()  # -> out; inputs z: Complex, y99: tree of String; same code as c_script_3
script_5 = ScriptEditor(ScriptComponent=c_script_4, Code=panel_3)  # -> Result, ComponentType, IsSDKMode, SourceCode, InputParams, OutputParams
