# Grasshopper definition sever_test.gh (Grasshopper 1.0.8)
# plug-ins: GrasshopperSever

# 通过TCP执行相关命令
toggle = BooleanToggle(False)
# 通过TCP传入命令，执行后返回
toggle_2 = BooleanToggle(False)
server = GHServer(Enabled=toggle, Port="6698")  # -> Status, OutPut
receiver = GHReceiver(Enabled=toggle_2, Port="6700")  # -> Client, LJson, Status
panel = Panel(server.OutPut)
actuator = GHActuator(LJson=receiver.LJson)  # -> Status, Result, OutPut
# 执行c#函数
cmdrhino = CommandRhino(Ljson=receiver.LJson)
sender = GHSender(Client=receiver.Client, LJson=actuator.Result)
# 发送rhino脚本
panel_2 = Panel(actuator.OutPut)
